# Grasshopper definition A1_RuiGu.gh (Grasshopper 1.0.7)
# plug-ins: ScriptParasite, Bifocals

number_slider = Slider(50, range=1..100)
number_slider_2 = Slider(3, range=1..10)
panel = Panel("E:\01_UCL\04_MorphogeneticProgramming\02_Assignment\A1\VisualStudio")

c_script = CSharpScript(
    steps=Slider(1, range=1..10),
    cellSize=number_slider_2,
    cellNumX=number_slider,
    cellNumY=number_slider,
    cellNumZ=number_slider,
    On=Toggle(False),
    reset=Button())  # -> out, A; inputs steps: Int32, cellSize: Int32, cellNumX: Int32, cellNumY: Int32, cellNumZ: Int32, On: Boolean, reset: Boolean
# ---------- c_script: C# additional code ----------
  //01 - declare variables that have to accessed every time the solution runs
  int counter = 1;

  bool[][] state;// = new bool[cellNumX][];
  bool[][] nextState;// = new bool[cellNumX][];

  List<Point3d> pts = new List<Point3d>();

  bool init = true;
  bool isRunning = false;



  public override void AfterRunScript()
  {
    if(isRunning)
      this.Component.ExpireSolution(true);
  }

  public void glider(bool[][] state, int x, int y)
  {
    state[x][y] = true;
    state[x - 1][y] = true;
    state[x + 1][y] = true;
    state[x + 1][y - 1] = true;
    state[x][y - 2] = true;
  }
# ---------- end c_script ----------
scriptpar = ScriptParasite(Enable=Toggle(False), Folder=panel)

dom = ConstructDomain(DomainStart=expr("-x*0.5", number_slider_2), DomainEnd=expr("x*0.5", number_slider_2))
multiplication = Multiplication(A=number_slider, B=number_slider_2)
pt = Point(c_script.A)
# Doubleclick Me!
box = CenterBox(Base=pt, X=1, Y=1, Z=1)
