# Grasshopper definition A4.gh (Grasshopper 1.0.7)

minz = Slider(-100, range=-100..100)
maxz = Slider(100, range=-100..100)
pt = Point(Point(-20.69766591, 74.42758639, -3.637978807e-12))
cir = Circle(Plane=pt, Radius=Slider(5, range=0..10))
quadtree = CSharpScript(
    minX=Slider(-100, range=-100..100),
    maxX=Slider(100, range=-100..100),
    minY=Slider(-100, range=-100..100),
    maxY=Slider(100, range=-100..100),
    minZ=minz,
    maxZ=maxz,
    AddPt=Button(),
    Reset=Button(),
    Add1000=Button(),
    Walker=pt)  # -> out, A, B, C; inputs minX: Double, maxX: Double, minY: Double, maxY: Double, minZ: Double, maxZ: Double, AddPt: Boolean, Reset: Boolean, Add1000: Boolean, Walker: Point3d
# ---------- quadtree: C# usings ----------
using System.IO;
using System.Linq;
using System.Data;
using System.Drawing;
using System.Reflection;
using System.Windows.Forms;
using System.Xml;
using System.Xml.Linq;
using System.Runtime.InteropServices;

using Rhino.DocObjects;
using Rhino.Collections;
using GH_IO;
using GH_IO.Serialization;
# ---------- quadtree: C# ----------
    if (init || Reset)
    {
      init = false;
      Reset = false;
      octree = new Octree(0, new Box(Plane.WorldXY, new Interval(minX, maxX),
        new Interval(minY, maxY), new Interval(minZ, maxZ)));
      insertedPts = new List<Point3d>();
    }

    if (AddPt) insertedPts.Add(AddRandomPt(octree, minX, maxX, minY, maxY, minZ, maxZ));
    if (Add1000)
    {
      for (int i = 0; i < 1000; i++)
      {
        insertedPts.Add(AddRandomPt(octree, minX, maxX, minY, maxY, minZ, maxZ));
      }
    }

    if (octree != null)
    {
      A = getAllBounds(octree);
      B = insertedPts;
      C = testWalker(octree, Walker);
    }
# ---------- quadtree: C# additional code ----------
  public static Octree octree;
  public static Random rnd = new Random();
  public static bool init = true;
  public static List <Point3d> insertedPts;

  public Point3d AddRandomPt(Octree o, double minX, double maxX, double minY, double maxY, double minZ, double maxZ)
  {
    var x = rnd.NextDouble() * (maxX - minX) + minX;
    var y = rnd.NextDouble() * (maxY - minY) + minY;
    var z = rnd.NextDouble() * (maxZ - minZ) + minZ;
    var p = new Point3d(x, y, z);
    o.insert(p);
    return p;
  }

  //class always has 3 things = (Properties, constructors , Methods)
  public class Octree
  {
    //Properties
    private Box bounds;
    private int level;
    private Octree [] nodes;
    private List<Point3d> objects;

    public int MAX_OBJECTS = 4;
    public int MAX_LEVELS = 10000;

    //Constructors

    public Octree(int pLevel, Box pBounds)
    {
      level = pLevel;
      nodes = new Octree[8];
      objects = new List<Point3d>();
      bounds = pBounds;

    }
    // functions in the class is called Methods

    public void clear()
    {
      objects.Clear();
      for(int i = 0; i < nodes.Length; ++i)
      {
        if(nodes[i] != null)
        {
          nodes[i].clear();
          nodes[i] = null;
        }
      }
    }
    private void split()
    {
      double subWidth = bounds.X.Length * 0.5;
      double subHeight = bounds.Y.Length * 0.5;
      double subDepth = bounds.Z.Length * 0.5;

      double x = bounds.X.T0;
      double y = bounds.Y.T0;
      double z = bounds.Z.T0;

      // 创建 8 个子立方体
      nodes[0] = new Octree(level + 1, new Box(new BoundingBox(
        new Point3d(x, y, z), new Point3d(x + subWidth, y + subHeight, z + subDepth))));

      nodes[1] = new Octree(level + 1, new Box(new BoundingBox(
        new Point3d(x + subWidth, y, z), new Point3d(x + 2 * subWidth, y + subHeight, z + subDepth))));

      nodes[2] = new Octree(level + 1, new Box(new BoundingBox(
        new Point3d(x, y + subHeight, z), new Point3d(x + subWidth, y + 2 * subHeight, z + subDepth))));

      nodes[3] = new Octree(level + 1, new Box(new BoundingBox(
        new Point3d(x + subWidth, y + subHeight, z), new Point3d(x + 2 * subWidth, y + 2 * subHeight, z + subDepth))));

      nodes[4] = new Octree(level + 1, new Box(new BoundingBox(
        new Point3d(x, y, z + subDepth), new Point3d(x + subWidth, y + subHeight, z + 2 * subDepth))));

      nodes[5] = new Octree(level + 1, new Box(new BoundingBox(
        new Point3d(x + subWidth, y, z + subDepth), new Point3d(x + 2 * subWidth, y + subHeight, z + 2 * subDepth))));

      nodes[6] = new Octree(level + 1, new Box(new BoundingBox(
        new Point3d(x, y + subHeight, z + subDepth), new Point3d(x + subWidth, y + 2 * subHeight, z + 2 * subDepth))));

      nodes[7] = new Octree(level + 1, new Box(new BoundingBox(
        new Point3d(x + subWidth, y + subHeight, z + subDepth), new Point3d(x + 2 * subWidth, y + 2 * subHeight, z + 2 * subDepth))));
    }

    private int getIndex(Point3d p)
    {
      //index should be in 0,1,2,3
      int index = -1;

      double midX = bounds.X.T0 + (bounds.X.Length * 0.5);
      double midY = bounds.Y.T0 + (bounds.Y.Length * 0.5);
      double midZ = bounds.Z.T0 + (bounds.Z.Length * 0.5);

      bool top = p.Y > midY;
      bool bottom = p.Y < midY;
      bool front = p.Z < midZ;
      bool back = p.Z > midZ;
      bool left = p.X < midX;
      bool right = p.X > midX;

      if (left && bottom && front) index = 0;
      else if (right && bottom && front) index = 1;
      else if (left && top && front) index = 2;
      else if (right && top && front) index = 3;
      else if (left && bottom && back) index = 4;
      else if (right && bottom && back) index = 5;
      else if (left && top && back) index = 6;
      else if (right && top && back) index = 7;

      return index;
    }

    public void insert(Point3d p)
    {
      if(nodes[0] != null)
      {
        int index = getIndex(p);
        if(index != -1)
        {
          nodes[index].insert(p);

          return;
        }
      }
      objects.Add(p);
      if (objects.Count > MAX_OBJECTS && level < MAX_LEVELS)
      {
        if(nodes[0] == null)
        {
          split();
        }
        int i = 0;

        while (i < objects.Count)
        {
          int index = getIndex(objects[i]);
          if (index != -1)
          {
            nodes[index].insert(objects[i]);
            objects.RemoveAt(i);
          }
          else
          {
            i++;
          }
        }
      }
    }

    public List<Point3d> retrieve(List<Point3d> returnObjects, Point3d p)
    {
      int index = getIndex(p);

      if (index != -1 && nodes[0] != null)
      {
        nodes[index].retrieve(returnObjects, p);
      }

      returnObjects.AddRange(objects);
      return returnObjects;
    }

    public List<Box> retrieveBounds(List<Box>boundsStore)
    {
      if(nodes[0] != null)
      {
        foreach(var n in nodes)n.retrieveBounds(boundsStore); //another way
      }
      if(nodes[0] == null)
      {
        boundsStore.Add(bounds);
      }
      return boundsStore;
    }
  }

  List<Point3d> testWalker(Octree node, Point3d w)
  {
    List<Point3d> returnObjects = new List<Point3d>();
    node.retrieve(returnObjects, w);
    return returnObjects;
  }

  List <Box> getAllBounds (Octree node)
  {
    var boundsStore = new List <Box>();
    node.retrieveBounds(boundsStore);
    return boundsStore;
  }
# ---------- end quadtree ----------
srf = Surface(cir)
preview = CustomPreview(Geometry=srf, Material=ColourSwatch(SwatchColor=RGB(0, 255, 111)))
brep = Brep(quadtree.A)
ln = Line(StartPoint=quadtree.C, EndPoint=pt)
pt_2 = Point(quadtree.C)
pt_3 = Point(quadtree.B)
wires = BrepWireframe(Brep=brep, Density=-1)
preview_2 = CustomPreview(Geometry=wires, Material=ColourSwatch(SwatchColor=RGBA(255, 186, 198, 253)))
preview_3 = CustomPreview(Geometry=brep, Material=ColourSwatch(SwatchColor=RGBA(156, 107, 242, 23)))
