# Grasshopper definition OptimizeGreenlandLayout_C#.gh (Grasshopper 1.0.7)
# plug-ins: MinimumBoundingBox, MeshEdit Components, Wallacei

# ---- group: GreenAreaNumber
number_slider = Slider(115, range=50..115)

# ----
# Maximize Green Visibility
brep = Brep([<brep referenced from the Rhino model> x10])
curve = Curve([<curve referenced from the Rhino model> x17])
divide_distance = DivideDistance(Curve=curve, Distance=Slider(5, range=5..10))  # -> Points, Tangents, Parameters
isovist = IsoVist(Plane=divide_distance.Points, Count=Slider(30, range=30..100), Radius=Slider(90, range=90..120), Obstacles=brep)  # -> Points, Distance, Index
line = Line(StartPoint=isovist.Points, EndPoint=divide_distance.Points)  # -> flatten(Line)

# ----
# Maximize Green Space Area
curve_2 = Curve([<curve referenced from the Rhino model> x12])
boundary_surfaces = BoundarySurfaces(Edges=curve_2)
number_slider_2 = Slider(5, range=0..10)
explode = Explode(Curve=boundary_surfaces, Recursive=True)  # -> Segments, Vertices
minimum_bounding_box_2d = MinimumBoundingBox2D(Points=explode.Vertices, Plane=PlaneXY(0, 0, 0))
dimensions = Dimensions(Surface=minimum_bounding_box_2d)  # -> UDimension, VDimension
division = Division(A=dimensions.VDimension, B=number_slider_2)
division_2 = Division(A=dimensions.UDimension, B=number_slider_2)
mesh_surface = MeshSurface(Surface=minimum_bounding_box_2d, UCount=division_2, VCount=division, Overhang=True, Equalize=False)
mesh_explode = MeshExplode(Mesh=mesh_surface, Interpolate=False)
wlc_01 = GenePool(
    Decimals=0,
    Maximum=1,
    Minimum=0,
    Value=[0.5404825883, 0.2891506718, 0.58937697, 0.3710417119, 0.8543598608, 0.8232174111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])
area = Area(Geometry=mesh_explode)  # -> Area, Centroid
face_boundaries = FaceBoundaries(Mesh=mesh_explode)
point_in_curve = PointInCurve(Point=area.Centroid, Curve=curve_2)  # -> Relationship, Point
surface = Surface(flatten(face_boundaries))
dispatch = Dispatch(List=surface, DispatchPattern=point_in_curve.Relationship)  # -> ListA, ListB
gene_pool_and_slider_shuffler = GenePoolAndSliderShuffler(BooleanButton=Button())
surface_2 = Surface(flatten(dispatch.ListA))
trim_solid = TrimSolid(Shape=surface_2, Cutters=brep)  # -> flatten(Result)
dispatch_2 = Dispatch(List=trim_solid, DispatchPattern=wlc_01)  # -> ListA, ListB
surface_3 = Surface(dispatch_2.ListA)
brep_join = BrepJoin(Breps=surface_3)  # -> Breps, Closed
list_length = ListLength(List=trim_solid)
area_2 = Area(Geometry=brep_join.Breps)  # -> Area, Centroid
panel = Panel(list_length)
sort_list = SortList(Keys=area_2.Area, ValuesValuesA=brep_join.Breps)  # -> Keys, reverse(ValuesValuesA)
series = Series(Start=0, Step=1, Count=number_slider)
list_item = ListItem(List=sort_list.ValuesValuesA, Index=series, Wrap=True)
brep_join_2 = BrepJoin(Breps=list_item)  # -> Breps, Closed
merge_faces = MergeFaces(Brep=brep_join_2.Breps)  # -> Breps, Before, After
area_3 = Area(Geometry=merge_faces.Breps)  # -> Area, Centroid
custom_preview = CustomPreview(Geometry=merge_faces.Breps, Material=ColourSwatch(SwatchColor=RGB(89, 148, 124)))
mass_addition = MassAddition(Input=area_3.Area)  # -> Result, PartialResults

preview = CustomPreview(Geometry=divide_distance.Points, Material=ColourSwatch(SwatchColor=RGB(115, 206, 240)))
preview_2 = CustomPreview(Geometry=line, Material=ColourSwatch(SwatchColor=RGB(87, 132, 148)))

collision_one_many = CollisionOneMany(Collider=line, Obstacles=merge_faces.Breps)  # -> Collision, Index
cull_pattern = CullPattern(List=line, CullPattern=collision_one_many.Collision)
list_length_2 = ListLength(List=cull_pattern)

custom_preview_2 = CustomPreview(Geometry=surface, Material=ColourSwatch(SwatchColor=RGB(89, 148, 124)))
custom_preview_3 = CustomPreview(Geometry=surface_3, Material=ColourSwatch(SwatchColor=RGB(89, 148, 124)))
custom_preview_4 = CustomPreview(Geometry=surface_2, Material=ColourSwatch(SwatchColor=RGB(80, 130, 166)))
panel_2 = Panel(list_length_2)
subtraction = Subtraction(A=Slider(6476, range=0..10000), B=mass_addition.Result)
negative = Negative(Value=list_length_2)
absolute = Absolute(Value=subtraction)
wlc_fc_view = Number(negative)
wlc_fc_srf = Number(absolute)
panel_3 = Panel(merge_faces.Breps)
green_visibility = Panel(wlc_fc_view)
green_space_visibility = Panel(wlc_fc_srf)
panel_4 = Panel(area_3.Area)
wallacei_x = WallaceiX(Genes=[number_slider, wlc_01], Objectives=[wlc_fc_srf, wlc_fc_view], popGen="50,100", total="17375", wlcDone=True)  # -> WallaceiGenomes, FitnessValues, Data, Phenotypes
generated_green_space_area = Panel(mass_addition.Result)

# ---- group: 基因序列可视化
decode_genome = DecodeGenome(WallaceiGenome=wallacei_x.WallaceiGenomes)  # disabled
number_slider_3 = Slider(49, range=0..49)  # disabled
number_slider_4 = Slider(20, range=0..20)  # disabled
tree_statistics = TreeStatistics(Tree=decode_genome)  # -> Paths, Length, Count; disabled
multiplication = Multiplication(A=number_slider_3, B=number_slider_4)  # disabled
series_2 = Series(Start=multiplication, Step=1, Count=number_slider_4)  # disabled
list_item_2 = ListItem(List=tree_statistics.Paths, Index=series_2, Wrap=True)  # disabled
tree_branch = TreeBranch(Tree=decode_genome, Path=list_item_2, MaintainPaths=True)  # disabled
button = Button()  # disabled
genomic_sequencing = GenomicSequencing(DecodedWallaceiGenomes=tree_branch, InitiateSequencing=button, gen=True, out=True)  # disabled
gradient_wlc_01 = Gradient(LowerLimit=0, UpperLimit=1, stops=[0.15: RGB(255, 130, 160), 0.85: RGB(220, 0, 40)])  # disabled
gradient_wlc_02 = Gradient(LowerLimit=0, UpperLimit=1, stops=[0.15: RGB(255, 130, 160), 0.85: RGB(220, 0, 40)])  # disabled
entwine = Entwine(Branch00=gradient_wlc_02, Branch01=gradient_wlc_01, FlattenInputs=True)  # disabled
point = Point(<point referenced from the Rhino model>)  # disabled
genomic_visualisation = GenomicVisualisation(
    DecodedWallaceiGenomes=tree_branch,
    AnnotationTextSize=0.5,
    GenesTextSize=0.3,
    GridSizeInXDirection=2,
    GridSizeInYDirection=1,
    HeightOfTheArrowsRepresentingChromosomes=0.5,
    LengthOfTheArrowsRepresentingChromosomes=2,
    OriginPointToVisualiseTheGenomicSequence=point,
    GradientInformation=entwine)  # -> OutputtedTheLineDrawings, OutputtedValuesForTheChromosomes, OutputtedMeshRepresentingTheGenomicSequence; disabled
number_slider_5 = Slider(100, range=0..100)  # disabled
param_viewer = ParamViewer(genomic_visualisation.OutputtedValuesForTheChromosomes)  # disabled
partition_list = PartitionList(List=genomic_visualisation.OutputtedValuesForTheChromosomes, Size=number_slider_5)  # disabled
bounds = Bounds(Numbers=partition_list)  # disabled
parero解集中各项参数取值区间 = Panel(bounds)  # disabled

# ----
number_slider_6 = Slider(250, range=0..500)  # disabled
number_slider_7 = Slider(12, range=0..20)  # disabled
distribute_to_grid = DistributeToGrid(
    FitnessValues=wallacei_x.FitnessValues,
    WallaceiPhenotypes=wallacei_x.Phenotypes,
    SizeOfTheGridInTheXDirection=number_slider_6,
    SizeOfTheGridInTheYDirection=number_slider_6,
    SizeOfTheTexts=number_slider_7,
    OutputOptions=0)  # -> DistributedFitnessValues, DistributedData, DistributedGeometries, DistributedMeshes, DistributedNumbers, GridLocations; disabled
